# Grasshopper definition 00_Rule based design.ghx (Grasshopper 1.0.7)

hello_world = GhPythonScript(
    iterations=Slider(1, range=0..10),
    rotation=Slider(30, range=0..100),
    angle=Slider(90, range=0..1000),
    length=Slider(3, range=0..10))  # -> out, L_System; inputs iterations: Int32
# ---------- hello_world: Python ----------
import random
import math
import Rhino.Geometry as rg

rule1_predecessor = "X"
rule1_successor = "F+[[X]-X]-F[-FX]+X)"
rule2_predecessor = "F"
rule2_successor = "FF"

genotype = "X"

for i in range(iterations):
    genotype=genotype.replace(rule1_predecessor, rule1_successor)
    genotype=genotype.replace(rule2_predecessor, rule2_successor)

vt = rg.Point3d(0,0,0)

vertices = []
angles = []
lines = []

for c in genotype:
    
    if c=="+":
        angle -=rotation
    elif c=='-':
        angle +=rotation
    elif c=='F':
        rad = math.radians(angle)
        nextVt = rg.Point3d(length*math.cos(rad) + vt.X, length*math.sin(rad) + vt.Y, 0)
        lines.append( rg.Line(vt, nextVt) )
        
        vt = nextVt
    
    elif c=='[':  
        vertices.append(vt) 
        angles.append(angle)
        
    elif c==']': 
        vt = vertices.pop()
        angle = angles.pop()

print (genotype)

L_System = lines
# ---------- end hello_world ----------
hello_world_2 = GhPythonScript(iterations=Slider(8, range=0..100), scale=Slider(0.4, range=0..1))  # -> out, lines; inputs iterations: Int32
# ---------- hello_world_2: Python ----------
import Rhino.Geometry as rg
import random
import math

lines = []

lines.append(rg.Line( rg.Point3d(400,100,0), rg.Point3d(400,400,0) ))
lines.append(rg.Line( rg.Point3d(400,400,0), rg.Point3d(400,100,0) ))

for i in range(iterations):
    newLines = []
    for edge in lines:
        v1 = edge.PointAt(0)
        v2 = edge.PointAt(1)
        vCenter = 0.5*(v1 + v2)
        v12 = v2 - v1
        #rotate 90
        trans = rg.Transform.Rotation(math.pi*0.5,v1)
        v12.Transform(trans)
        # scale
        v12 *= scale
        # add
        vCenter +=v12
        
        newLines.append( rg.Line(v1, vCenter) )
        newLines.append( rg.Line(vCenter, v2) )
    # overwrite the edges with the new edges
    lines = newLines
# ---------- end hello_world_2 ----------
line = Line(hello_world_2.lines)
line_2 = Line(hello_world.L_System)
item = ListItem(List=hello_world.L_System, Index=0, Wrap=True)
item_2 = ListItem(List=hello_world.L_System, Index=Slider(3, range=0..10), Wrap=True)
item_3 = ListItem(List=hello_world.L_System, Index=Slider(1, range=0..1), Wrap=True)
item_4 = ListItem(List=hello_world.L_System, Index=Slider(2, range=0..10), Wrap=True)
item_5 = ListItem(List=hello_world.L_System, Index=Slider(4, range=0..10), Wrap=True)
item_6 = ListItem(List=hello_world.L_System, Index=Slider(5, range=0..10), Wrap=True)
crv = Curve()
